# Grasshopper definition PickPlace_Robot.gh (Grasshopper 1.0.8)
# plug-ins: RhinoCodePluginGH, Robots

# ---- group: Gripper Unclose / TCP orientation setup
tcp_unclose = Point(<point referenced from the Rhino model>)
xy_plane = XYPlane(Origin=tcp_unclose)
deconstruct_plane = DeconstructPlane(Plane=xy_plane)  # -> Origin, XAxis, YAxis, ZAxis
deconstruct_plane_2 = DeconstructPlane(Plane=xy_plane)  # -> Origin, XAxis, YAxis, ZAxis
deconstruct_plane_3 = DeconstructPlane(Plane=xy_plane)  # -> Origin, XAxis, YAxis, ZAxis
rotate_3d = Rotate3D(Geometry=xy_plane, Angle=degrees(Slider(0, range=0..100)), Center=deconstruct_plane.Origin, Axis=deconstruct_plane.XAxis)  # -> Geometry, Transform
rotate_3d_2 = Rotate3D(
    Geometry=rotate_3d.Geometry,
    Angle=degrees(Slider(0, range=0..100)),
    Center=deconstruct_plane_2.Origin,
    Axis=deconstruct_plane_2.YAxis)  # -> Geometry, Transform
rotate_3d_3 = Rotate3D(
    Geometry=rotate_3d_2.Geometry,
    Angle=degrees(Slider(0, range=0..100)),
    Center=deconstruct_plane_3.Origin,
    Axis=deconstruct_plane_3.ZAxis)  # -> Geometry, Transform

# ---- group: Gripper Close / TCP orientation setup
tcp_close = Point(<point referenced from the Rhino model>)
xy_plane_2 = XYPlane(Origin=tcp_close)
# Tool center point creation and Tool integration
number_slider = Slider(0, range=0..100)
deconstruct_plane_4 = DeconstructPlane(Plane=xy_plane_2)  # -> Origin, XAxis, YAxis, ZAxis
deconstruct_plane_5 = DeconstructPlane(Plane=xy_plane_2)  # -> Origin, XAxis, YAxis, ZAxis
deconstruct_plane_6 = DeconstructPlane(Plane=xy_plane_2)  # -> Origin, XAxis, YAxis, ZAxis
rotate_3d_4 = Rotate3D(Geometry=xy_plane_2, Angle=degrees(number_slider), Center=deconstruct_plane_4.Origin, Axis=deconstruct_plane_4.XAxis)  # -> Geometry, Transform
rotate_3d_5 = Rotate3D(
    Geometry=rotate_3d_4.Geometry,
    Angle=degrees(Slider(0, range=0..100)),
    Center=deconstruct_plane_5.Origin,
    Axis=deconstruct_plane_5.YAxis)  # -> Geometry, Transform
rotate_3d_6 = Rotate3D(
    Geometry=rotate_3d_5.Geometry,
    Angle=degrees(Slider(0, range=0..100)),
    Center=deconstruct_plane_6.Origin,
    Axis=deconstruct_plane_6.ZAxis)  # -> Geometry, Transform

# ----
brep = Brep([<brep referenced from the Rhino model> x8])
unclose_geometry = Brep([<brep referenced from the Rhino model> x8])

# ---- group: Gripper Close / Close Gripper
mesh_brep = MeshBrep(
    Brep=brep,
    Settings={GridMaxCount=0, GridMinCount=16, JaggedSeams=False, MaxEdgeLength=0, MinEdgeLength=0.0001, MinTolerance=0, Refine=True, RefineAngle=0, RelativeTolerance=0.65, SimplePlanes=True, Tolerance=0})
mesh = Mesh(mesh_brep)
mesh_join = MeshJoin(Meshes=mesh)

# ---- group: Gripper Unclose / Close Gripper
mesh_brep_2 = MeshBrep(
    Brep=unclose_geometry,
    Settings={GridMaxCount=0, GridMinCount=16, JaggedSeams=False, MaxEdgeLength=0, MinEdgeLength=0.0001, MinTolerance=0, Refine=True, RefineAngle=0, RelativeTolerance=0.65, SimplePlanes=True, Tolerance=0})
mesh_2 = Mesh(mesh_brep_2)
mesh_join_2 = MeshJoin(Meshes=mesh_2)

# ---- group: Gripper Close
create_tool = CreateTool(Name="GripperClose", TCP=rotate_3d_6.Geometry, Weight="5.6", Mesh=mesh_join)  # -> Tool, TCP

# ---- group: Gripper Unclose
create_tool_2 = CreateTool(Name="GripperUnclose", TCP=rotate_3d_3.Geometry, Weight="5.6", Mesh=mesh_join_2)  # -> Tool, TCP

# ----
panel = Panel("Home target definition")

# ---- group: Home position close gripper Target
joint_configuration = Panel("0,pi/2,0,0,0,0")
speed_mm_s = Panel("100")
panel_2 = Panel("""SetDO out1, 0;
SetDO out2, 0;""")
zone_mm = Panel("0")
custom_command = CustomCommand(Name="GripperSignalZero", Manufacturer="All", Code=panel_2)
joints_parameter = JointsParameter(joint_configuration)
speed_parameter = SpeedParameter(speed_mm_s)
create_target = CreateTarget(Joints=joints_parameter, Tool=create_tool.Tool, Speed=speed_parameter, Zone=zone_mm, IsCartesian=False)

# ---- group: Home position unclose Target
panel_3 = Panel("""SetDO out1, 0;
SetDO out2, 0;""")
joint_configuration_2 = Panel("0,pi/2,0,0,0,0")
speed_mm_s_2 = Panel("100")
zone_mm_2 = Panel("0")
custom_command_2 = CustomCommand(Name="GripperSignalZero", Manufacturer="All", Code=panel_3)
joints_parameter_2 = JointsParameter(joint_configuration_2)
speed_parameter_2 = SpeedParameter(speed_mm_s_2)
create_target_2 = CreateTarget(
    Joints=joints_parameter_2,
    Tool=create_tool_2.Tool,
    Speed=speed_parameter_2,
    Zone=zone_mm_2,
    Command=custom_command_2,
    IsCartesian=False)

# ---- group: Bricks plane creation
brep_2 = Brep([<brep referenced from the Rhino model> x8])
list_length = ListLength(List=brep_2)
deconstruct_brep = DeconstructBrep(Brep=brep_2)  # -> flatten(Faces), Edges, Vertices
series = Series(Start=2, Step=6, Count=list_length)
list_item = ListItem(List=deconstruct_brep.Faces, Index=series, Wrap=True)
# Bricks plane and Table plan creation
polygon_center = PolygonCenter(Polyline=list_item)  # -> CenterV, CenterE, CenterA
construct_plane = ConstructPlane(Origin=polygon_center.CenterV, XAxis=Vector(1, 0, 0), YAxis=Vector(0, 1, 0))
unit_z = UnitZ(Factor="200")
flip_plane = FlipPlane(Plane=construct_plane, ReverseX=False, ReverseY=False, SwapAxes=True)
plane_offset = PlaneOffset(BasePlane=construct_plane, Offset=unit_z)
flip_plane_2 = FlipPlane(Plane=plane_offset, ReverseX=False, ReverseY=False, SwapAxes=True)
deconstruct_plane_7 = DeconstructPlane(Plane=flip_plane)  # -> Origin, XAxis, YAxis, ZAxis
deconstruct_plane_8 = DeconstructPlane(Plane=flip_plane_2)  # -> Origin, XAxis, YAxis, ZAxis
multiplication = Multiplication(A=deconstruct_plane_7.ZAxis, B=Slider(200, range=0..1000))
rotate_3d_7 = Rotate3D(
    Geometry=flip_plane,
    Angle=degrees(Slider(90, range=-180..180)),
    Center=deconstruct_plane_7.Origin,
    Axis=deconstruct_plane_7.ZAxis)  # -> Geometry, Transform
vector_display = VectorDisplay(Anchor=deconstruct_plane_7.Origin, Vector=multiplication)
rotate_3d_8 = Rotate3D(
    Geometry=flip_plane_2,
    Angle=degrees(Slider(90, range=-180..180)),
    Center=deconstruct_plane_8.Origin,
    Axis=deconstruct_plane_8.ZAxis)  # -> Geometry, Transform

# ---- group: Table Plane Creation
subtraction = Subtraction(A=list_length, B=1)
curve = Curve(<curve referenced from the Rhino model>)
divide_curve = DivideCurve(Curve=curve, Count=subtraction, Kinks=False)  # -> Points, Tangents, Parameters
xy_plane_3 = XYPlane(Origin=divide_curve.Points)
unit_z_2 = UnitZ(Factor="200")
flip_plane_3 = FlipPlane(Plane=xy_plane_3, ReverseX=False, ReverseY=False, SwapAxes=True)
plane_offset_2 = PlaneOffset(BasePlane=xy_plane_3, Offset=unit_z_2)
flip_plane_4 = FlipPlane(Plane=plane_offset_2, ReverseX=False, ReverseY=False, SwapAxes=True)

# ---- group: Target Creation -B
panel_4 = Panel("""SetDO out1, 1;
WaitTime 1;
SetDO out1, 0;""")
custom_command_3 = CustomCommand(Name="CloseTheGripper", Manufacturer="All", Code=panel_4)
list = ValueList({"Joint", "Linear"}, selected="Linear")
list_2 = ValueList({"Joint", "Linear"}, selected="Joint")
# Targets creation and scheduling
series_2 = Series(Start=0, Step=1, Count=8)
unclose_gripper = ToolParameter(create_tool_2.Tool)
create_target_3 = CreateTarget(Plane=rotate_3d_7.Geometry, Motion=list, Tool=unclose_gripper, Speed="10", Command=custom_command_3, IsCartesian=True)
create_target_4 = CreateTarget(Plane=rotate_3d_8.Geometry, Motion=list_2, Tool=unclose_gripper, Speed=Slider(200, range=0..1000), IsCartesian=True)
insert_items = InsertItems(List=create_target_4, Indices=series_2, Wrap=True)
close_gripper = ToolParameter(create_tool.Tool)
list_length_2 = ListLength(List=create_target_3)
series_3 = Series(Start=2, Step=2, Count=list_length_2)
panel_5 = Panel("""SetDO out2, 1;
WaitTime 1;
SetDO out2, 0;""")
home_target = TargetParameter(create_target_2)
list_3 = ValueList({"Joint", "Linear"}, selected="Linear")
insert_items_2 = InsertItems(List=insert_items, Item=create_target_3, Indices=series_3, Wrap=True)
series_4 = Series(Start=0, Step=3, Count=list_length_2)
create_target_5 = CreateTarget(Plane=rotate_3d_8.Geometry, Motion=list_3, Tool=close_gripper, Speed=Slider(10, range=0..1000), IsCartesian=True)
custom_command_4 = CustomCommand(Name="OpenTheGripper", Manufacturer="All", Code=panel_5)
insert_items_3 = InsertItems(List=insert_items_2, Item=home_target, Indices=series_4, Wrap=True)
series_5 = Series(Start=4, Step=4, Count=list_length_2)
list_4 = ValueList({"Joint", "Linear"}, selected="Joint")
home_target_2 = TargetParameter(create_target)
list_5 = ValueList({"Joint", "Linear"}, selected="Linear")
insert_items_4 = InsertItems(List=insert_items_3, Item=create_target_5, Indices=series_5, Wrap=True)
series_6 = Series(Start=5, Step=5, Count=list_length_2)
create_target_6 = CreateTarget(Plane=flip_plane_4, Motion=list_4, Tool=close_gripper, Speed="100", IsCartesian=True)
speed_mm_s_3 = Panel("100")
joint_configuration_3 = Panel("0,pi/2,0,0,0,0")
create_target_7 = CreateTarget(Plane=flip_plane_3, Motion=list_5, Tool=close_gripper, Speed="10", Command=custom_command_4, IsCartesian=True)
insert_items_5 = InsertItems(List=insert_items_4, Item=home_target_2, Indices=series_6, Wrap=True)
series_7 = Series(Start=6, Step=6, Count=list_length_2)
joints_parameter_3 = JointsParameter(joint_configuration_3)
speed_parameter_3 = SpeedParameter(speed_mm_s_3)
series_8 = Series(Start=7, Step=7, Count=list_length_2)
insert_items_6 = InsertItems(List=insert_items_5, Item=create_target_6, Indices=series_7, Wrap=True)
zone_mm_3 = Panel("0")
series_9 = Series(Start=8, Step=8, Count=list_length_2)
insert_items_7 = InsertItems(List=insert_items_6, Item=create_target_7, Indices=series_8, Wrap=True)
create_target_8 = CreateTarget(Joints=joints_parameter_3, Tool=create_tool_2.Tool, Speed=speed_parameter_3, Zone=zone_mm_3, IsCartesian=False)
insert_items_8 = InsertItems(List=insert_items_7, Item=create_target_8, Indices=series_9, Wrap=True)

# ---- group: Programm Selection
value_list = ValueList({"A": 0, "B": 1}, selected="B")
stream_filter = StreamFilter(Gate=value_list, Stream1=insert_items_8)

# ---- group: Programm Generation
list_6 = RobotsLibrary(
    {"Indexlab-IRB6700-175", "Indexlab-IRB6700-175 + Positioner", "Indexlab", "Indexlab_ABB_IRB4600_205", "FanucM710iC", "FanucM710iC+GudelFanuc", "Fanuc R 2000 iC", "Fanuc R 2000 iC+GudelFanuc", "Fanuc Cell Indexlab", "Indexlab_Fanuc_LRMate200iD7L"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}, selected="Indexlab_ABB_IRB4600_205",
    Type=0)
xy_plane_4 = XYPlane(Origin=Point(0, 0, 0))
flip_plane_5 = FlipPlane(Plane=xy_plane_4, ReverseX=False, ReverseY=False, SwapAxes=False)
load_robot_system = LoadRobotSystem(Name=list_6, Base=flip_plane_5)
create_program = CreateProgram(Name="Home", RobotSystem=load_robot_system, Targets=stream_filter, StepSize=1)  # -> Program, Code, Duration, Warnings, Errors
panel_6 = Panel(create_program.Warnings)

# ----
# Programm Generation and Simulation
panel_7 = Panel(create_program.Duration)
panel_8 = Panel(create_program.Errors)
code = Panel(create_program.Code)

# ---- group: Bricks Transport Visualisation / One brick
brep_3 = Brep(<brep referenced from the Rhino model>)

# ----
panel_9 = Panel("Collision check ")

# ---- group: Simulation
number_slider_2 = Slider(0, range=0..1)

program_simulation = ProgramSimulation(Program=create_program.Program, Time=number_slider_2, Normalized=True)  # -> SystemMeshes, JointRotations, Plane, Index, Time, Program, Errors

# ----
degrees = Degrees(Radians=program_simulation.JointRotations)

# ---- group: Simulation (continued)
target_index = Panel(program_simulation.Index)
time = Panel(program_simulation.Time)
errors = Panel(degrees)

# ---- group: Table collision check
brep_4 = Brep(<brep referenced from the Rhino model>)
mesh_brep_3 = MeshBrep(
    Brep=brep_4,
    Settings={GridMaxCount=0, GridMinCount=16, JaggedSeams=False, MaxEdgeLength=0, MinEdgeLength=0.0001, MinTolerance=0, Refine=True, RefineAngle=0, RelativeTolerance=0.65, SimplePlanes=True, Tolerance=0})
collision_one_many = CollisionOneMany(Collider=program_simulation.SystemMeshes, Obstacles=mesh_brep_3)  # -> Collision, Index
panel_10 = Panel(collision_one_many.Collision)

# ---- group: Bricks Transport Visualisation / TCP Plane
list_item_2 = ListItem(List=program_simulation.Plane, Index=-1, Wrap=True)

# ---- group: Collision checked on brick / Gripper
list_item_3 = ListItem(List=program_simulation.SystemMeshes, Index=7, Wrap=True)

# ---- group: Bricks Transport Visualisation
deconstruct_brep_2 = DeconstructBrep(Brep=brep_3)  # -> Faces, Edges, Vertices
rotate_plane = RotatePlane(Plane=deconstruct_brep_2.Faces, Angle=degrees("90"))
plane_offset_3 = PlaneOffset(BasePlane=rotate_plane, Offset="-80")
list_item_4 = ListItem(List=plane_offset_3, Index=0, Wrap=True)
orient = Orient(Geometry=brep_3, Source=list_item_4, Target=list_item_2)  # -> Geometry, Transform
create_material = CreateMaterial(
    Diffuse=ColourSwatch(SwatchColor=RGB(23, 172, 255)),
    Specular=RGB(255, 255, 255),
    Emission=RGB(0, 0, 0),
    Transparency=0,
    Shine=0)

# ---- group: Collision checked on brick
collision_one_many_2 = CollisionOneMany(Collider=list_item_3, Obstacles=orient.Geometry)  # -> Collision, Index
python_3_script = Python3Script(x=collision_one_many_2.Collision, y=orient.Geometry)  # -> out, a
# ---------- python_3_script: Python ----------
if x==True:
    a = y
else:
    a = None
# ---------- end python_3_script ----------

# ----
panel_11 = Panel(collision_one_many_2.Collision)

# ---- group: Bricks Transport Visualisation (continued)
custom_preview = CustomPreview(Geometry=python_3_script.a, Material=create_material)
